# Grasshopper definition 160420_PEV_Sim_Data.gh (Grasshopper 0.9.76)
# plug-ins: SonicStringDup

# OD Demand Data - dense
panel = Panel("24")
number_slider = Slider(0.5, range=0.1..5)
number_slider_2 = Slider(1, range=0.1..5)
# OD Demand Data - sparse
number_slider_3 = Slider(15, range=0..100)
# Road Pt Data
panel_2 = Panel("start")
number_slider_4 = Slider(1000, range=1..10000)  # disabled
number_slider_5 = Slider(0, range=0..100)  # disabled

# ---- group: RD CRV ONE WAY
crv = Curve(reparameterize([<curve referenced from the Rhino model> x108]))

# ---- group: RD CRV TWO WAY
crv_2 = Curve()

# ----
number_slider_6 = Slider(1000, range=1..10000)  # disabled
multiplication = Multiplication(A="24", B="60")
number_slider_7 = Slider(0, range=0..100)  # disabled
multiplication_2 = Multiplication(A=panel, B="60")
# Problem Pts
panel_3 = Panel("1390.86, 1013.399")
txt = Text("two way")
txt_2 = Text("one way")
panel_4 = Panel(multiplication)
txt_3 = Text(panel_2)
txt_4 = Text("end")
panel_5 = Panel(multiplication_2)

# ---- group: STEP LENGTH
num = Number(number_slider_3)

# ----
len = Length(Curve=crv_2)
len_2 = Length(Curve=crv)
dom = ConstructDomain(DomainStart=0, DomainEnd=panel_4)
pt = Point(panel_3)
division = Division(A=len, B=num)
dom_2 = ConstructDomain(DomainStart=0, DomainEnd=panel_5)
division_2 = Division(A=len_2, B=num)
xz = XZPlane(Origin=Point(0, 0, 0))
pt_2 = Point("1538.621, 1001.687")
pt_3 = Point("1071.844, 1304.987")
random = Random(Range=dom, Number=number_slider_4, Seed=number_slider_5)  # disabled
divlength = DivideLength(Curve=crv_2, Length=num)  # -> Points, Tangents, Parameters
lng = ListLength(List=crv)
lng_2 = ListLength(List=crv_2)
divlength_2 = DivideLength(Curve=crv, Length=num)  # -> Points, Tangents, Parameters
random_2 = Random(Range=dom_2, Number=number_slider_6, Seed=number_slider_7)  # disabled
divide = DivideCurve(Curve=crv_2, Count=division, Kinks=False)  # -> Points, Tangents, Parameters
divide_2 = DivideCurve(Curve=crv, Count=division_2, Kinks=False)  # -> Points, Tangents, Parameters
mirror = Mirror(Geometry=pt, Plane=xz)  # -> Geometry, Transform
int = Integer(random)  # disabled
pt_4 = Point([pt_2, pt_3])
int_2 = Integer(random_2)  # disabled
range = Range(Domain=dom, Steps=panel_4)
repeat = RepeatData(Data=txt_3, Length=lng_2)  # -> graft(Data)
repeat_2 = RepeatData(Data=txt_3, Length=lng)  # -> graft(Data)
repeat_3 = RepeatData(Data=txt, Length=lng_2)  # -> graft(Data)
repeat_4 = RepeatData(Data=txt_4, Length=lng_2)  # -> graft(Data)
repeat_5 = RepeatData(Data=txt_2, Length=lng)  # -> graft(Data)
repeat_6 = RepeatData(Data=txt_4, Length=lng)  # -> graft(Data)
range_2 = Range(Domain=dom_2, Steps=panel_5)
xz_2 = XZPlane(Origin=Point(0, 0, 0))
pt_5 = Point(divide_2.Points)
pt_6 = Point(divide.Points)
pt_7 = Point(mirror.Geometry)
stringdup = StringDuplicates(String=int)  # -> R, i, P; disabled
stringdup_2 = StringDuplicates(String=int_2)  # -> R, i, P; disabled
shift = ShiftList(List=range, Shift=-1, Wrap=False)
mirror_2 = Mirror(Geometry=pt_4, Plane=xz_2)  # -> Geometry, Transform
shift_2 = ShiftList(List=range_2, Shift=-1, Wrap=False)
xz_3 = XZPlane(Origin=Point(0, 0, 0))
pshift = ShiftPaths(Data=repeat_3, Offset=1)
pshift_2 = ShiftPaths(Data=repeat_4, Offset=1)
pshift_3 = ShiftPaths(Data=repeat_5, Offset=1)
pshift_4 = ShiftPaths(Data=repeat_6, Offset=1)
pshift_5 = ShiftPaths(Data=repeat, Offset=1)
pshift_6 = ShiftPaths(Data=repeat_2, Offset=1)
dom_3 = ConstructDomain(DomainStart=0, DomainEnd=expr("X-1", panel_5))
pshift_7 = ShiftPaths(Data=shift_2, Offset=-1)
int_3 = Integer(shift)
sort = SortList(Keys=stringdup.R)  # -> Keys, ValuesA; disabled
mirror_3 = Mirror(Geometry=pt_5, Plane=xz_3)  # -> Geometry, Transform

# ---- group: all road pts
pt_8 = Point(flatten([mirror_3.Geometry, pt_6]))

pt_9 = Point(flatten([mirror_3.Geometry, pt_6]))

# ----
lng_3 = ListLength(List=pt_8)
lng_4 = ListLength(List=pt_9)
subtraction = Subtraction(A=lng_3, B=1)
subtraction_2 = Subtraction(A=lng_4, B=1)
dom_4 = ConstructDomain(DomainStart=0, DomainEnd=subtraction)
dom_5 = ConstructDomain(DomainStart=0, DomainEnd=subtraction_2)
pt_10 = Point(mirror_3.Geometry)
pdecon = Deconstruct(Point=pt_10)  # -> XComponent, YComponent, ZComponent
pt_11 = Point(mirror_2.Geometry)
panel_6 = Panel(pdecon.XComponent)
sort_2 = SortList(Keys=stringdup_2.R)  # -> Keys, ValuesA; disabled
xz_4 = XZPlane(Origin=Point(0, 0, 0))
int_4 = Integer(pshift_7)
pshift_8 = ShiftPaths(Data=sort.Keys, Offset=-1)  # disabled
pshift_9 = ShiftPaths(Data=sort_2.Keys, Offset=-1)  # disabled
mirror_4 = Mirror(Geometry=pt_6, Plane=xz_4)  # -> Geometry, Transform

# ---- group: none dup time
int_5 = Integer(pshift_8)  # disabled

# ----
lng_5 = ListLength(List=int_5)  # disabled
panel_7 = Panel(lng_5)  # disabled
panel_8 = Panel(mirror_4.Geometry)

# ---- group: none dup time
int_6 = Integer(pshift_9)  # disabled

# ----
lng_6 = ListLength(List=int_6)  # disabled
panel_9 = Panel(lng_6)  # disabled
panel_10 = Panel(int_5)  # disabled
number_slider_8 = Slider(1000, range=0..1000)
multiplication_3 = Multiplication(A=panel_6, B=number_slider_8)
multiplication_4 = Multiplication(A=pdecon.YComponent, B=number_slider_8)
multiplication_5 = Multiplication(A=pdecon.ZComponent, B=number_slider_8)
panel_11 = Panel(int_6)  # disabled
number_slider_9 = Slider(1000, range=0..1000)
int_7 = Integer(multiplication_3)
int_8 = Integer(multiplication_4)
int_9 = Integer(multiplication_5)
division_3 = Division(A=int_7, B=number_slider_8)
division_4 = Division(A=int_8, B=number_slider_8)
division_5 = Division(A=int_9, B=number_slider_8)
panel_12 = Panel(division_3)
graph = GraphMapper(
    int_3,
    x0=0,
    x1=1440,
    y0=0,
    y1=1,
    container_name="Sine Summation",
    Equation0_px=[0.4998726845, 0],
    Equation0_py=[0.1522498727, 0],
    Equation1_px=[0, 0.2534573674],
    Equation1_py=[0.08167254925, 0.3417996764])
rep = ReplaceText(Text=panel_8, Find=", ", Replace=",", RecursiveReplace=False)
pt_12 = ConstructPoint(XCoordinate=panel_12, YCoordinate=division_4, ZCoordinate=division_5)
rep_2 = ReplaceText(Text=rep, Find="{", RecursiveReplace=False)
random_3 = Random(Range=Domain(0, 1), Number=panel_4, Seed=Slider(0, range=0..100))
pt_13 = Point(pt_12)
panel_13 = Panel(pt_13)
rep_3 = ReplaceText(Text=panel_13, Find=", ", Replace=",", RecursiveReplace=False)
rep_4 = ReplaceText(Text=rep_3, Find="{", RecursiveReplace=False)
rep_5 = ReplaceText(Text=rep_2, Find="}", RecursiveReplace=False)
rep_6 = ReplaceText(Text=rep_4, Find="}", RecursiveReplace=False)
panel_14 = Panel(graph)
panel_15 = Panel(random_3)
panel_16 = Panel(rep_5)
panel_17 = Panel(rep_6)
smaller = SmallerThan(FirstNumber=panel_15, SecondNumber=panel_14)  # -> SmallerThan, OrEqualTo
cull = CullPattern(List=int_3, CullPattern=smaller.OrEqualTo)
pshift_10 = ShiftPaths(Data=cull, Offset=-1)
merge = Merge(Data1=pshift_5, Data2=pshift, Data3=panel_16, Data4=pshift_2)
merge_2 = Merge(Data1=pshift_6, Data2=pshift_3, Data3=panel_17, Data4=pshift_4)
random_4 = Random(Range=dom_3, Number=Slider(5238, range=0..10000), Seed=Slider(56, range=0..100))
item = ListItem(List=int_4, Index=graft(random_4), Wrap=True)
pshift_11 = ShiftPaths(Data=item, Offset=-1)
sort_3 = SortList(Keys=pshift_11)  # -> Keys, ValuesA

# ---- group: minutes
int_10 = Integer(sort_3.Keys)

# ----
graph_2 = GraphMapper(
    int_10,
    x0=0,
    x1=1440,
    y0=0,
    y1=1,
    container_name="Sine Summation",
    Equation0_px=[0.4998726845, 0],
    Equation0_py=[0.1522498727, 0],
    Equation1_px=[0, 0.2534573674],
    Equation1_py=[0.08167254925, 0.3417996764])
lng_7 = ListLength(List=int_10)
random_5 = Random(Range=Domain(0, 1), Number=lng_7, Seed=Slider(87, range=0..100))
panel_18 = Panel(graph_2)
panel_19 = Panel(random_5)
smaller_2 = SmallerThan(FirstNumber=panel_19, SecondNumber=panel_18)  # -> SmallerThan, OrEqualTo
cull_2 = CullPattern(List=int_10, CullPattern=smaller_2.OrEqualTo)
pshift_12 = ShiftPaths(Data=cull_2, Offset=-1)

# ---- group: time that has requests
int_11 = Integer(pshift_10)

# ----
lng_8 = ListLength(List=int_11)
random_6 = Random(Range=dom_4, Number=lng_8, Seed=Slider(0, range=0..100))
random_7 = Random(Range=dom_4, Number=lng_8, Seed=Slider(1, range=0..1))
int_12 = Integer(random_7)
int_13 = Integer(random_6)
item_2 = ListItem(List=pt_8, Index=int_12, Wrap=True)
item_3 = ListItem(List=pt_8, Index=int_13, Wrap=True)
pshift_13 = ShiftPaths(Data=item_2, Offset=-1)
pshift_14 = ShiftPaths(Data=item_3, Offset=-1)

# ---- group: dropoff pts
pt_14 = Point(pshift_13)

# ---- group: pickup pts
pt_15 = Point(pshift_14)

# ----
pdecon_2 = Deconstruct(Point=pt_14)  # -> XComponent, YComponent, ZComponent
pdecon_3 = Deconstruct(Point=pt_15)  # -> XComponent, YComponent, ZComponent
multiplication_6 = Multiplication(A=pdecon_3.XComponent, B=number_slider_8)
multiplication_7 = Multiplication(A=pdecon_3.YComponent, B=number_slider_8)
multiplication_8 = Multiplication(A=pdecon_2.XComponent, B=number_slider_8)
multiplication_9 = Multiplication(A=pdecon_2.YComponent, B=number_slider_8)
int_14 = Integer(multiplication_6)
int_15 = Integer(multiplication_7)
int_16 = Integer(multiplication_8)
int_17 = Integer(multiplication_9)
division_6 = Division(A=int_14, B=number_slider_8)
division_7 = Division(A=int_15, B=number_slider_8)
division_8 = Division(A=int_16, B=number_slider_8)
division_9 = Division(A=int_17, B=number_slider_8)
panel_20 = Panel(division_9)
panel_21 = Panel(division_8)
panel_22 = Panel(division_7)
panel_23 = Panel(division_6)
merge_3 = Merge(Data1=graft(int_11), Data2=graft(panel_23), Data3=graft(panel_22), Data4=graft(panel_21), Data5=graft(panel_20))
join = TextJoin(Text=merge_3, Join=",")
panel_24 = Panel(lng_8)
pshift_15 = ShiftPaths(Data=join, Offset=-1)

# ---- group: time that has requests
int_18 = Integer(pshift_12)

# ----
lng_9 = ListLength(List=int_18)
random_8 = Random(Range=dom_5, Number=lng_9, Seed=Slider(19, range=0..100))
random_9 = Random(Range=dom_5, Number=lng_9, Seed=Slider(73, range=0..100))
int_19 = Integer(random_9)
int_20 = Integer(random_8)
item_4 = ListItem(List=pt_9, Index=int_19, Wrap=True)
item_5 = ListItem(List=pt_9, Index=int_20, Wrap=True)
pshift_16 = ShiftPaths(Data=item_4, Offset=-1)
pshift_17 = ShiftPaths(Data=item_5, Offset=-1)

# ---- group: dropoff pts
pt_16 = Point(pshift_16)

# ---- group: pickup pts
pt_17 = Point(pshift_17)

# ----
pdecon_4 = Deconstruct(Point=pt_16)  # -> XComponent, YComponent, ZComponent
pdecon_5 = Deconstruct(Point=pt_17)  # -> XComponent, YComponent, ZComponent
multiplication_10 = Multiplication(A=pdecon_5.XComponent, B=number_slider_9)
multiplication_11 = Multiplication(A=pdecon_5.YComponent, B=number_slider_9)
multiplication_12 = Multiplication(A=pdecon_4.XComponent, B=number_slider_9)
multiplication_13 = Multiplication(A=pdecon_4.YComponent, B=number_slider_9)
int_21 = Integer(multiplication_10)
int_22 = Integer(multiplication_11)
int_23 = Integer(multiplication_12)
int_24 = Integer(multiplication_13)
division_10 = Division(A=int_21, B=number_slider_9)
division_11 = Division(A=int_22, B=number_slider_9)
division_12 = Division(A=int_23, B=number_slider_9)
division_13 = Division(A=int_24, B=number_slider_9)
panel_25 = Panel(division_13)
panel_26 = Panel(division_12)
panel_27 = Panel(division_11)
panel_28 = Panel(division_10)
merge_4 = Merge(Data1=graft(int_18), Data2=graft(panel_28), Data3=graft(panel_27), Data4=graft(panel_26), Data5=graft(panel_25))
join_2 = TextJoin(Text=merge_4, Join=",")
panel_29 = Panel(lng_9)
flatten = FlattenTree(Tree=merge, Path="{0}")
flatten_2 = FlattenTree(Tree=merge_2, Path="{0}")
pshift_18 = ShiftPaths(Data=join_2, Offset=-1)
panel_30 = Panel(int_11)
panel_31 = Panel(int_18)
pshift_19 = ShiftPaths(Data=pshift_15, Offset=-1)
pshift_20 = ShiftPaths(Data=pshift_18, Offset=-1)
merge_5 = Merge(Data1=flatten_2, Data2=flatten)
panel_32 = Panel(merge_5)
merge_6 = Merge(Data1="Time,PickupX,PickupY,DropoffX,DropoffY", Data2=pshift_19)
merge_7 = Merge(Data1="Time,PickupX,PickupY,DropoffX,DropoffY", Data2=pshift_20)
panel_33 = Panel(merge_6)
panel_34 = Panel(merge_7)
